# Grasshopper definition PM_CCC_001_BeforeLifeCame.gh (Grasshopper 1.0.7)
# plug-ins: Bifocals, Pufferfish

number_slider = Slider(2, range=0..10)
# https://www.holybooks.com/wp-content/uploads/Phenomenon-of-Man-by-Pierre-Teilhard-de-Chardin.pdf
# From the dawn of his existence, man has been held up as a
# spectacle to himself. Indeed for tens of centuries he has looked at
# nothing but himself. Yet he has onlyjust begun to take a scientific
# view of his own significance in the physical world. There is no
# need to be surprised at this slow awakening. It often happens
# that what stares us in the face is the most difficult to perceive.
# The child has to learn to separate out the images which assail
# the newly-opened retina. For man to discover man and take his
# measure, a whole series of ' senses ' have been necessary, whose
# gradual acquisition, as we shall show, covers and punctuates the
# whole history of the snuggles of the mind :
# A sense of spatial immensity, in greatness and smallness, dis
# articulating and spacing out, withln a sphere of indefinite radius,
# the orbits of the objects which press round us ;
# A sense of depth, pushing back laboriously through endless
# series and measureless distances of time, which a sort of sluggish
# ness of mind tends continually to condense for us in a thin layer
# of he past ;
# A sense of number, discovering and grasping unflinchingly
# the bewildering multitude of material or living elements involved
# in the slightest change in the universe ;
# A sense of proportion, realising as best we can the di&rence
# of physical scale which separates, both in rhythm and dimension,
# the atom from the nebula, the infmitesimal from the immense ;
# A sense of quality, or of novelty, enabling us to distinguish in
# nature certain absolute stages of perfection and growth, without
# upsetting the physical unity of the world ;
# A sense of movement, capable of perceiving the irresistible
# development. hidden in extreme slowness-extreme agitation
# concealed beneath a veil of immobility-the entirely new insinuating
# itself into the heart of the monotonous repetition of the
# same things ;
# A sense, lastly, of the organic, discovering physical links and
# structural unity under the superficial juxtaposition of successions
# and collectivities.
# Without these qualities to illuminate our vision, man will
# remain indefinitely for us-whatever is done to make us seewhat he
# still reprcsents to so many minds : an erratic object in a
# disjointed world. Conversely, we have only to rid our vision of
# the threefold illusion of smallness, plurality and immobility, for
# man effortlessly to take the central position we prophesied-the
# momentary summit of an anthropogenesis which is itself the
# crown of a cosmogenesis.
# BOOK ONE
# BEFORE LIFE CAME
# Curve creation and continuilty
# concepts and techniques related to NURBS curves
# 
# Curve building techniques have a significant
#  effect on the surfaces that you build from them
# 
# Curve degree
# The degree of a curve refers to the highest
#  degree polynomial in the equation for the curve,
# it relates to the extent of the influence a single
# control point has ove the length of the curve
# Create random pts in the x-direction
number_slider_2 = Slider(6, range=0..10)
negative = Negative(Value=number_slider)
construct_domain = ConstructDomain(DomainStart=negative, DomainEnd=number_slider)
series = Series(Start=0, Step=1, Count=number_slider_2)
random = Random(Range=construct_domain, Number=number_slider_2, Seed=Slider(41, range=0..100))

# ----
# Degree of Curve
panel = Panel("1")

construct_point = ConstructPoint(XCoordinate=series, YCoordinate=random, ZCoordinate=0)
stream_filter = StreamFilter(Gate=Slider(1, range=0..4), Stream0=panel, Stream1="2", Stream2="3", Stream3="4", Stream4="5")
nurbs_curve = NurbsCurve(Vertices=construct_point, Degree=stream_filter, Periodic=False)  # -> Curve, Length, Domain

# ----
# Turn On Control Points of Curve
number_slider_3 = Slider(3, range=0..10)
control_points = ControlPoints(Curve=nurbs_curve.Curve)  # -> Points, Weights, Knots
point = Point(control_points.Points)
list_item = ListItem(List=point, Index=number_slider_3, Wrap=True)
deconstruct_vector = DeconstructVector(Vector=list_item)  # -> XComponent, YComponent, ZComponent
addition = Addition(A=deconstruct_vector.YComponent, B=Slider(-3, range=-3..3))
construct_point_2 = ConstructPoint(XCoordinate=deconstruct_vector.XComponent, YCoordinate=addition, ZCoordinate=deconstruct_vector.ZComponent)
replace_items = ReplaceItems(List=control_points.Points, Item=construct_point_2, Indices=number_slider_3, Wrap=False)
nurbs_curve_2 = NurbsCurve(Vertices=replace_items, Degree=stream_filter, Periodic=False)  # -> Curve, Length, Domain

# ----
# Rebuilding Curve
number_slider_4 = Slider(6, range=0..10)
rebuild_curve = RebuildCurve(Curve=nurbs_curve_2.Curve, Count=number_slider_4, Degree=stream_filter, EndTangents=False)

# ----
# Curvature Graph: Circle and Vector
t = Slider(0.54, range=0..1)
# Indicates the curvature on the curve
# This is the inverse of the radius curvature
# Smaller radius of curvature at t,
# the larger the amount of curvature
curvature = Curvature(Curve=reparameterize(rebuild_curve), Parameter=t)  # -> Point, Curvature, Curvature_2
circle = Circle(curvature.Curvature_2)
vector = Vector(curvature.Curvature)
vector_display = VectorDisplay(Anchor=curvature.Point, Vector=vector)

# ----
# Check if Polyline End Script Here
panel_2 = Panel("Contains(x,\"line\")")
panel_3 = Panel(nurbs_curve.Curve)
eval = Evaluate(F=panel_2, x=panel_3)
panel_4 = Panel(eval)

stream_gate = StreamGate(Stream=nurbs_curve.Curve, Gate=eval)  # -> Target0, Target1

curve = Curve(stream_gate.Target1)
