# Grasshopper definition PM_CCC_005_BeforeLifeCame.gh (Grasshopper 1.0.7)
# plug-ins: Bifocals, Pufferfish, LunchBox, Human, MeshEdit Components

# ----
# CHAPTER ONE
# THE STUFF OF THE UNIVERSE
# To PUSH anything back into the past is equivalent to reducing
# it to its simplest elements. Traced as far as possible in the direction
# of their origins, the last fibres of the human aggregate are lost to
# view and are merged in our eyes with the very stuff of the
# universe.
number_slider = Slider(2, range=0..10)  # disabled
construct_point = ConstructPoint(XCoordinate=number_slider, YCoordinate=number_slider, ZCoordinate=number_slider)  # disabled

# ----
# I. ELEMENTAL MATTER
# Observed from this special angle, and considered at the outset in
# its elemental state (by which I mean at any moment, at any
# point, and in any volume), the stuff of tangible things reveals
# itself with increasing insistence as radically particulate yet essentially related, and lastly,
# prodigiously active.
# Plurality, unity, energy : the three faces of matter.
# A. Plurality
# The profoundly ' atomic 'l character of the universe is visible in
# everyday experience, in raindrops and grains of sand, in the hosts
# of the living, and the multitude of stars ; even in the ashes of the
# dead. Man has needed neither microscope nor electronic analysis
# in order to suspect that he lives surrounded by and resting on dust.
# But to count the grains and describe them, all the patient craft of
# modern science was necessary. The atoms of Epicurus were inert
# and indivisible. And the infinitesimal worlds of Pascal could still
# possess their animalcules. Today we have gone far beyond such
# instinctive or inspired guesswork both in certainty and precision.
# The scaling down is unlimited. Like the tiny diatom shells whose
# markings, however magnified, change almost indefinitely into
# new patterns, so each parucle of matter, ever smaller and smaller,
# under the physicist's analysis tends to reduce itself into some
# dung yet more finely gtanulated. And at each new step in
# this progressive approach to the infinitely small the whole
# configuration of the world is for a moment blurred and then
# renewed.
# [Atomid&.]
trigger = Trigger(Interval=20, TimerInterval=20, Target=data_recorder)  # disabled
panel = Panel("1")  # disabled
data_recorder = DataRecorder(flatten(panel), DataLimit=100, RecordData=True)  # disabled
# When we probe beyond a certain degree of depth and dilution,
# the familiar properties of our bodies-light, colour, warmth,
# impenetrability, etc.-lose their meaning.
# Indeed our sensory experience turns out to be a floating
# condensation on a swarm of the undefinable. Bewildering in its
# multiplicity and its minuteness, the substratum of the tangible
# universe is in an unending state of disintegration as it goes downward.
number_slider_2 = Slider(0.007, range=0..0.1)  # disabled
list_length = ListLength(List=data_recorder)  # disabled
number_slider_3 = Slider(100, range=0..100)  # disabled
multiplication = Multiplication(A=list_length, B=number_slider_2)  # disabled
circle = Circle(Plane=PlaneXY(0, 0, 0), Radius=multiplication)  # disabled
divide_curve = DivideCurve(Curve=circle, Count=number_slider_3, Kinks=False)  # -> Points, Tangents, Parameters; disabled
sine = Sine(Value=multiplication)  # disabled
panel_2 = Panel(sine)  # disabled
list_item = ListItem(List=divide_curve.Points, Index=list_length, Wrap=True)  # disabled
multiplication_2 = Multiplication(A=multiplication, B=sine)  # disabled
point = Point(list_item)  # disabled
panel_3 = Panel(list_item)  # disabled
# B. Unity
# On the other hand the more we split and pulverise matter
# artificially, the more insistently it proclaims its fundamental unity.
# In its most imperfect form, but the simplest to imagine, this
# unity reveals itself in the astonishing similarity of the elements
# met with. Molecules, atoms, electrons-whatever the name,
# whatever the scale-these minute units (at any rate when viewed
# from our distance) manifest a perfect identity of mass and of
# behaviour. In their dimensions and actions they seem
# astonishingly dbrated-and monotonous. It is almost as if all that
# surface play which charms our lives tends to disappear at deeper
# levels. It is almost as if the stuff of which all stuff is made were
# reducible in the end to some simple and unique kind of substance
boolean_toggle = BooleanToggle(True)  # disabled
sphere = Sphere(Base=point, Radius=multiplication_2)  # disabled
bake_geometry = BakeGeometry(Bake=boolean_toggle, Geometry=sphere, DeleteOldBakes=False, PreserveTrees=False)  # disabled

# ----
# Degree of Curve
panel_4 = Panel("1")  # disabled
panel_5 = Panel("2")  # disabled
panel_6 = Panel("3")  # disabled
panel_7 = Panel("4")  # disabled
panel_8 = Panel("5")  # disabled

# ----
# BOOK ONE
# BEFORE LIFE CAME
# Curve creation and continuilty
# concepts and techniques related to NURBS curves
# 
# Curve building techniques have a significant
#  effect on the surfaces that you build from them
# 
# Curve degree
# The degree of a curve refers to the highest
#  degree polynomial in the equation for the curve,
# it relates to the extent of the influence a single
# control point has ove the length of the curve
# Create random pts in the x-direction
# Indicates the curvature on the curve
# This is the inverse of the radius curvature
# Smaller radius of curvature at t,
# the larger the amount of curvature
# Create Geometry
number_slider_4 = Slider(1.91, range=0.1..4)  # disabled
number_slider_5 = Slider(93, range=0..100)  # disabled
# https://www.holybooks.com/wp-content/uploads/Phenomenon-of-Man-by-Pierre-Teilhard-de-Chardin.pdf
# From the dawn of his existence, man has been held up as a
# spectacle to himself. Indeed for tens of centuries he has looked at
# nothing but himself. Yet he has onlyjust begun to take a scientific
# view of his own significance in the physical world. There is no
# need to be surprised at this slow awakening. It often happens
# that what stares us in the face is the most difficult to perceive.
# The child has to learn to separate out the images which assail
# the newly-opened retina. For man to discover man and take his
# measure, a whole series of ' senses ' have been necessary, whose
# gradual acquisition, as we shall show, covers and punctuates the
# whole history of the snuggles of the mind :
# A sense of spatial immensity, in greatness and smallness, dis
# articulating and spacing out, withln a sphere of indefinite radius,
# the orbits of the objects which press round us ;
# A sense of depth, pushing back laboriously through endless
# series and measureless distances of time, which a sort of sluggish
# ness of mind tends continually to condense for us in a thin layer
# of he past ;
# A sense of number, discovering and grasping unflinchingly
# the bewildering multitude of material or living elements involved
# in the slightest change in the universe ;
# A sense of proportion, realising as best we can the di&rence
# of physical scale which separates, both in rhythm and dimension,
# the atom from the nebula, the infmitesimal from the immense ;
# A sense of quality, or of novelty, enabling us to distinguish in
# nature certain absolute stages of perfection and growth, without
# upsetting the physical unity of the world ;
# A sense of movement, capable of perceiving the irresistible
# development. hidden in extreme slowness-extreme agitation
# concealed beneath a veil of immobility-the entirely new insinuating
# itself into the heart of the monotonous repetition of the
# same things ;
# A sense, lastly, of the organic, discovering physical links and
# structural unity under the superficial juxtaposition of successions
# and collectivities.
# Without these qualities to illuminate our vision, man will
# remain indefinitely for us-whatever is done to make us seewhat he
# still reprcsents to so many minds : an erratic object in a
# disjointed world. Conversely, we have only to rid our vision of
# the threefold illusion of smallness, plurality and immobility, for
# man effortlessly to take the central position we prophesied-the
# momentary summit of an anthropogenesis which is itself the
# crown of a cosmogenesis.
number_slider_6 = Slider(6, range=3..10)  # disabled
negative = Negative(Value=number_slider_4)  # disabled
construct_domain = ConstructDomain(DomainStart=negative, DomainEnd=number_slider_4)  # disabled
series = Series(Start=0, Step=1, Count=number_slider_6)  # disabled
number_slider_7 = Slider(0, range=0..4)  # disabled
number_slider_8 = Slider(4, range=1..4)  # disabled
random = Random(Range=construct_domain, Number=number_slider_6, Seed=number_slider_5)  # disabled
addition = Addition(A=random, B=panel_6)  # disabled
construct_point_2 = ConstructPoint(XCoordinate=0, YCoordinate=addition, ZCoordinate=series)  # disabled
stream_filter = StreamFilter(Gate=number_slider_8, Stream0=panel_4, Stream1=panel_5, Stream2=panel_6, Stream3=panel_7, Stream4=panel_8)  # disabled
nurbs_curve = NurbsCurve(Vertices=construct_point_2, Degree=stream_filter, Periodic=False)  # -> Curve, Length, Domain; disabled
construct_point_3 = ConstructPoint(XCoordinate=0, YCoordinate=0, ZCoordinate=0)  # disabled
number_slider_9 = Slider(12, range=0..100)  # disabled
line_sdl = LineSDL(Start=construct_point_3, Direction=Vector(0, 0, 1), Length=1)  # disabled
unit_x = UnitX(Factor=number_slider_9)  # disabled
number_slider_10 = Slider(2, range=0..10)  # disabled
number_slider_11 = Slider(0.04, range=0..1)  # disabled
linear_array = LinearArray(Geometry=construct_point_3, Direction=unit_x, Count=stream_filter)  # -> Geometry, Transform; disabled
list_item_2 = ListItem(List=linear_array.Geometry, Index=expr("x-1", stream_filter), Wrap=True)  # disabled
boolean_toggle_2 = BooleanToggle(False)  # disabled

# ----
# Turn On Control Points of Curve
number_slider_12 = Slider(5, range=0..10)  # disabled
control_points = ControlPoints(Curve=nurbs_curve.Curve)  # -> Points, Weights, Knots; disabled
point_2 = Point(control_points.Points)  # disabled
list_item_3 = ListItem(List=point_2, Index=number_slider_12, Wrap=True)  # disabled
number_slider_13 = Slider(-1, range=-3..3)  # disabled
deconstruct_vector = DeconstructVector(Vector=list_item_3)  # -> XComponent, YComponent, ZComponent; disabled
addition_2 = Addition(A=deconstruct_vector.YComponent, B=number_slider_13)  # disabled
construct_point_4 = ConstructPoint(XCoordinate=deconstruct_vector.XComponent, YCoordinate=addition_2, ZCoordinate=deconstruct_vector.ZComponent)  # disabled
replace_items = ReplaceItems(List=control_points.Points, Item=construct_point_4, Indices=number_slider_12, Wrap=False)  # disabled
nurbs_curve_2 = NurbsCurve(Vertices=replace_items, Degree=stream_filter, Periodic=False)  # -> Curve, Length, Domain; disabled

# ----
# Rebuilding Curve
number_slider_14 = Slider(6, range=0..10)  # disabled
rebuild_curve = RebuildCurve(Curve=nurbs_curve_2.Curve, Count=number_slider_14, Degree=stream_filter, EndTangents=False)  # disabled

# ----
# Curvature Graph: Circle and Vector
t = Slider(0.32, range=0..1)  # disabled
curvature = Curvature(Curve=reparameterize(rebuild_curve), Parameter=t)  # -> Point, Curvature, Curvature_2; disabled
circle_2 = Circle(curvature.Curvature_2)  # disabled
vector = Vector(curvature.Curvature)  # disabled
vector_display = VectorDisplay(Anchor=curvature.Point, Vector=vector)  # disabled

# ----
# Thus the unity of homogeneity.
# 
# To the cosmic corpuscles we
# should find it natural to attribute an individual radius of action
# as limited as their dimensions. We find, on the contrary, that
# each of them can only be defined by virtue of in influence on all
# around it. Whatever space we suppose it to be in, each cosmic
# element radiates in it and entirely fills it. However narrowly the
# ' heart ' ofan atom may becircurnscribed, in realm is co-extensive,
# at least potentially, with that of every other atom. This strange
# property we will come across again, even in the human molecule.
# 
# We add : collective unity.
# 
# The innumerable foci which share
# a given volume of matter are not therefore independent of each
# other. Something holds them together. Far from behaving as a
# mere inert receptacle, the space filled by their multitude operates
# upon it like an active centre of direction and transmission in which
# their plurality is organiscd. We do not get what we call matter
# as a result of the simple aggregation and juxtaposition of atoms.
# For that, a mysterious identity must absorb and cement them, an
# influence at which our mind rebels in bewilderment at first but
# which in the end it must perforce accept.
# 
# We mean the sphere above the centres and enveloping them.
# Throughout these pages, in each new phase of anthrop*
# genesis, we shall find ourselves faced by the unimaginable reality
# of collective bonds, and we shall have to struggle with them
# without ceasing until we succeed in recognising and defining their
# true nature.
# 
# Here in the beginning it is sufficient to include them
# all under the empirical name given by science to their common
# initial principle, namely enwgy.
panel_9 = Panel("10")
multiplication_3 = Multiplication(A="50", B=panel_9)
mesh_sphere = MeshSphere(Base=PlaneXY(0, 0, 0), Radius="50", UCount=10, VCount=20)
populate_3d = Populate3D(Region=mesh_sphere, Count=multiplication_3, Seed=1)

# ----
# IsInside = mesh.IsPointInside(pt, tol, true);
testpointinsidemesh = TestPointInsideMesh(mesh=mesh_sphere, pt=populate_3d)  # -> out, IsInside; inputs mesh: Mesh, pt: Point3d, tol: Double
# ---------- testpointinsidemesh: C# usings ----------
using System.IO;
using System.Linq;
using System.Data;
using System.Drawing;
using System.Reflection;
using System.Windows.Forms;
using System.Xml;
using System.Xml.Linq;
using System.Runtime.InteropServices;

using Rhino.DocObjects;
using Rhino.Collections;
using GH_IO;
using GH_IO.Serialization;
# ---------- testpointinsidemesh: C# ----------
    //Test if a given point is inside a mesh
    IsInside = mesh.IsPointInside(pt, tol, true);
# ---------- end testpointinsidemesh ----------

cull_pattern = CullPattern(List=populate_3d, CullPattern=testpointinsidemesh.IsInside)
list_length_2 = ListLength(List=flatten(cull_pattern))
construct_domain_2 = ConstructDomain(DomainStart="3", DomainEnd=list_length_2)
range = Range(Domain=construct_domain_2, Steps=expr("x-1", list_length_2))
integer = Integer(range)
mesh_sphere_2 = MeshSphere(Base=flatten(cull_pattern), Radius=Slider(1, range=0..1), UCount=integer, VCount=integer)
mesh_volume = MeshVolume(Mesh=mesh_sphere_2)  # -> Volume, Centroid
panel_10 = Panel(mesh_volume.Volume)
larger_than = LargerThan(FirstNumber=mesh_volume.Volume, SecondNumber=Slider(3.1572, range=3..5))  # -> LargerThan, OrEqualTo
smaller_than = SmallerThan(FirstNumber=mesh_volume.Volume, SecondNumber=Slider(4.19, range=3..5))  # -> SmallerThan, OrEqualTo
cull_pattern_2 = CullPattern(List=mesh_sphere_2, CullPattern=larger_than.OrEqualTo)
cull_pattern_3 = CullPattern(List=cull_pattern_2, CullPattern=smaller_than.SmallerThan)

# ----
# Check if Polyline End Script Here
panel_11 = Panel("Contains(x,\"line\")")  # disabled
panel_12 = Panel(nurbs_curve.Curve)  # disabled
eval = Evaluate(F=panel_11, x=panel_12)  # disabled
panel_13 = Panel(eval)  # disabled

stream_gate = StreamGate(Stream=nurbs_curve.Curve, Gate=eval)  # -> Target0, Target1; disabled

curve = Curve(stream_gate.Target1)  # disabled

stream_filter_2 = StreamFilter(Gate=eval, Stream0=rebuild_curve, Stream1=curve)  # disabled
revolution = Revolution(Curve=stream_filter_2, Axis=line_sdl, Domain=Domain(0, 6.283185307))  # disabled
cap_holes = CapHoles(Brep=revolution)  # disabled
shell_polysurface = ShellPolysurface(Polysurface=cap_holes, Removal=number_slider_10, Thickness=number_slider_11, FaceMerge=False)  # disabled
orient = Orient(Geometry=shell_polysurface, Source=construct_point_3, Target=list_item_2)  # -> Geometry, Transform; disabled
object_bake = ObjectBake(
    BakeToggle=boolean_toggle_2,
    GeometryObjects=orient.Geometry,
    Layer="GH_Bake",
    ObjectName="GH_Obj",
    ObjectColor=RGB(255, 255, 255),
    LayerColor=RGB(255, 255, 255))  # disabled
