# Grasshopper definition PM_CCC_008_BeforeLifeCame.gh (Grasshopper 1.0.7)
# plug-ins: Bifocals, Pufferfish, LunchBox, Human, MeshEdit Components

construct_point = ConstructPoint(XCoordinate=0, YCoordinate=0, ZCoordinate=0)
# Curve continuity and curvature graph
# Rhino has two analysis commands that will help illustrate the difference between curvature and tangency. In the
# following exercise, we will use the CurvatureGraph and the Curvature commands to gain a better understanding of
# tangent and curvature continuity
panel = Panel("10")
negative = Negative(Value=panel)
vector_xyz = VectorXYZ(XComponent=0, YComponent=negative, ZComponent=0)  # -> Vector, Length
vector_xyz_2 = VectorXYZ(XComponent=negative, YComponent=0, ZComponent=0)  # -> Vector, Length
vector_xyz_3 = VectorXYZ(XComponent=0, YComponent=panel, ZComponent=0)  # -> Vector, Length
vector_xyz_4 = VectorXYZ(XComponent=panel, YComponent=0, ZComponent=0)  # -> Vector, Length
vector_display = VectorDisplay(Anchor=construct_point, Vector=vector_xyz.Vector)
vector_display_2 = VectorDisplay(Anchor=construct_point, Vector=vector_xyz_2.Vector)
vector_display_3 = VectorDisplay(Anchor=construct_point, Vector=vector_xyz_3.Vector)
vector_display_4 = VectorDisplay(Anchor=construct_point, Vector=vector_xyz_4.Vector)

# ----
# CHAPTER ONE
# THE STUFF OF THE UNIVERSE
# To PUSH anything back into the past is equivalent to reducing
# it to its simplest elements. Traced as far as possible in the direction
# of their origins, the last fibres of the human aggregate are lost to
# view and are merged in our eyes with the very stuff of the
# universe.
number_slider = Slider(2, range=0..10)  # disabled
construct_point_2 = ConstructPoint(XCoordinate=number_slider, YCoordinate=number_slider, ZCoordinate=number_slider)  # disabled

# ----
# I. ELEMENTAL MATTER
# Observed from this special angle, and considered at the outset in
# its elemental state (by which I mean at any moment, at any
# point, and in any volume), the stuff of tangible things reveals
# itself with increasing insistence as radically particulate yet essentially related, and lastly,
# prodigiously active.
# Plurality, unity, energy : the three faces of matter.
# A. Plurality
# The profoundly ' atomic 'l character of the universe is visible in
# everyday experience, in raindrops and grains of sand, in the hosts
# of the living, and the multitude of stars ; even in the ashes of the
# dead. Man has needed neither microscope nor electronic analysis
# in order to suspect that he lives surrounded by and resting on dust.
# But to count the grains and describe them, all the patient craft of
# modern science was necessary. The atoms of Epicurus were inert
# and indivisible. And the infinitesimal worlds of Pascal could still
# possess their animalcules. Today we have gone far beyond such
# instinctive or inspired guesswork both in certainty and precision.
# The scaling down is unlimited. Like the tiny diatom shells whose
# markings, however magnified, change almost indefinitely into
# new patterns, so each parucle of matter, ever smaller and smaller,
# under the physicist's analysis tends to reduce itself into some
# dung yet more finely gtanulated. And at each new step in
# this progressive approach to the infinitely small the whole
# configuration of the world is for a moment blurred and then
# renewed.
# [Atomid&.]
trigger = Trigger(Interval=20, TimerInterval=20, Target=data_recorder)  # disabled
panel_2 = Panel("1")  # disabled
data_recorder = DataRecorder(flatten(panel_2), DataLimit=100, RecordData=True)  # disabled
# When we probe beyond a certain degree of depth and dilution,
# the familiar properties of our bodies-light, colour, warmth,
# impenetrability, etc.-lose their meaning.
# Indeed our sensory experience turns out to be a floating
# condensation on a swarm of the undefinable. Bewildering in its
# multiplicity and its minuteness, the substratum of the tangible
# universe is in an unending state of disintegration as it goes downward.
number_slider_2 = Slider(0.007, range=0..0.1)  # disabled
list_length = ListLength(List=data_recorder)  # disabled
number_slider_3 = Slider(100, range=0..100)  # disabled
multiplication = Multiplication(A=list_length, B=number_slider_2)  # disabled
circle = Circle(Plane=PlaneXY(0, 0, 0), Radius=multiplication)  # disabled
divide_curve = DivideCurve(Curve=circle, Count=number_slider_3, Kinks=False)  # -> Points, Tangents, Parameters; disabled
sine = Sine(Value=multiplication)  # disabled
panel_3 = Panel(sine)  # disabled
list_item = ListItem(List=divide_curve.Points, Index=list_length, Wrap=True)  # disabled
multiplication_2 = Multiplication(A=multiplication, B=sine)  # disabled
point = Point(list_item)  # disabled
panel_4 = Panel(list_item)  # disabled
# B. Unity
# On the other hand the more we split and pulverise matter
# artificially, the more insistently it proclaims its fundamental unity.
# In its most imperfect form, but the simplest to imagine, this
# unity reveals itself in the astonishing similarity of the elements
# met with. Molecules, atoms, electrons-whatever the name,
# whatever the scale-these minute units (at any rate when viewed
# from our distance) manifest a perfect identity of mass and of
# behaviour. In their dimensions and actions they seem
# astonishingly dbrated-and monotonous. It is almost as if all that
# surface play which charms our lives tends to disappear at deeper
# levels. It is almost as if the stuff of which all stuff is made were
# reducible in the end to some simple and unique kind of substance
boolean_toggle = BooleanToggle(True)  # disabled
sphere = Sphere(Base=point, Radius=multiplication_2)  # disabled
bake_geometry = BakeGeometry(Bake=boolean_toggle, Geometry=sphere, DeleteOldBakes=False, PreserveTrees=False)  # disabled

panel_5 = Panel("1")  # disabled
panel_6 = Panel("10")  # disabled
# Curve and surface continuity
# Since creating a good surface so often depends upon the quality and continuity of the input curves, it is worthwhile
# clarifying the concept of continuity among curves.
# For most curve building and surface building purposes we can talk about four useful levels of continuity:
# 
# Not continuous
# The curves or surfaces do not meet at their end points or edges.
# Where there is no continuity, the objects cannot be
# joined.
# 
# Positional continuity (G0)
# Curves meet at their end points, surfaces meet at their edges.
# Positional continuity means that there is a kink at the point where two curves meet.
#  The curves can be joined in Rhino
# into a single curve but there will be a kink and the curve can still be exploded into at least two sub-curves.
# Similarly two surfaces may meet along a common edge but will show a kink or seam, a hard line between the surfaces.
# For practical purposes, only the endpoints of a curve or the last rows of points along the edges of two untrimmed
# surfaces need to match to determine G0 continuity.
# 
# Tangency continuity (G1)
# Curves or surfaces meet and the directions of the tangents at the endpoints or edges is the same.
# You should not see a
# crease or a sharp edge.
# Tangency is the direction of a curve at any particular point along the curve
# Where two curves meet at their endpoints the tangency condition between them is determined by the direction in
# which the curves are each heading exactly at their endpoints.
# If the directions are collinear, then the curves are
# considered tangent.
# There is no hard corner or kink where the two curves meet. This tangency direction is controlled
# by the direction of the line between the end control point and the next control point on a curve.
# In order for two curves to be tangent to one another, their endpoints must be coincident (G0) and the second control
# point on each curve must lie on a line passing through the curve endpoints.
# A total of four control points, two from
# each curve, must lie on this imaginary line.
# 
# Curvature continuity (G2)
# Curves or surfaces meet, their tangent directions are the same and the radius of curvature is the same for each at the
# endpoint.
# Curvature Continuity includes the above G0 and G1 conditions and adds the further requirement that the radius of
# curvature be the same at the common endpoints of the two curves.
# Curvature continuity is the smoothest condition
# over which the user has any direct control, although smoother relationships are possible.
# For example, G3 continuity means that not only are the conditions for G2 continuity met, but also that the rate of
# change of the curvature is the same on both curves or surfaces at the common endpoints or edges.
# G4 means that the rate of change of the rate of change of the curvature is the same for both curves where they meet.
# This is the smoothest type of join. Rhino has tools to build such curves and surfaces, but fewer tools for checking and
# verifying such continuity than for G0-G2.
# G5+ has no visible evidence of more continuity.
panel_7 = Panel("0")  # disabled
construct_point_3 = ConstructPoint(XCoordinate=[panel_7, panel_6], YCoordinate=panel_5, ZCoordinate=0)  # disabled
construct_point_4 = ConstructPoint(XCoordinate=[panel_7, panel_6], YCoordinate=0, ZCoordinate=0)  # disabled
dispatch = Dispatch(List=flatten(construct_point_4), DispatchPattern=[True, False])  # -> ListA, ListB; disabled
line = Line(StartPoint=dispatch.ListA, EndPoint=dispatch.ListB)  # disabled
divide_curve_2 = DivideCurve(Curve=line, Count=expr("x-1", panel_6), Kinks=False)  # -> Points, Tangents, Parameters; disabled
panel_8 = Panel("{0;0}[5]")  # disabled
panel_9 = Panel("{0;0}[3,5,7]")  # disabled
panel_10 = Panel("{0;0}[1to8]")  # disabled
split_tree = SplitTree(Data=divide_curve_2.Points, Masks=flatten(panel_9))  # -> Positive, Negative; disabled
split_tree_2 = SplitTree(Data=divide_curve_2.Points, Masks=flatten(panel_8))  # -> Positive, Negative; disabled
panel_11 = Panel("1")  # disabled
split_tree_3 = SplitTree(Data=divide_curve_2.Points, Masks=flatten(panel_10))  # -> Positive, Negative; disabled
panel_12 = Panel("1")  # disabled
panel_13 = Panel("1")  # disabled
dispatch_2 = Dispatch(List=flatten(construct_point_3), DispatchPattern=[True, False])  # -> ListA, ListB; disabled
dispatch_3 = Dispatch(List=flatten(construct_point_3), DispatchPattern=[True, False])  # -> ListA, ListB; disabled
dispatch_4 = Dispatch(List=flatten(construct_point_3), DispatchPattern=[True, False])  # -> ListA, ListB; disabled
clean_tree = CleanTree(RemoveNulls=panel_12, RemoveInvalid=panel_12, RemoveEmpty=panel_12, Tree=split_tree_2.Positive)  # disabled
clean_tree_2 = CleanTree(RemoveNulls=panel_11, RemoveInvalid=panel_11, RemoveEmpty=panel_11, Tree=split_tree.Positive)  # disabled
clean_tree_3 = CleanTree(RemoveNulls=panel_13, RemoveInvalid=panel_13, RemoveEmpty=panel_13, Tree=split_tree_3.Positive)  # disabled
merge = Merge(Data1=clean_tree, Data2=dispatch_2.ListA, Data3=dispatch_2.ListB)  # -> flatten(Result); disabled
merge_2 = Merge(Data1=clean_tree_2, Data2=dispatch_3.ListA, Data3=dispatch_3.ListB)  # -> flatten(Result); disabled
merge_3 = Merge(Data1=clean_tree_3, Data2=dispatch_4.ListA, Data3=dispatch_4.ListB)  # -> flatten(Result); disabled
sort_list = SortList(Keys=merge, ValuesValuesA=merge)  # -> Keys, ValuesValuesA; disabled
sort_list_2 = SortList(Keys=merge_2, ValuesValuesA=merge_2)  # -> Keys, ValuesValuesA; disabled
number_slider_4 = Slider(3, range=0..10)  # disabled
number_slider_5 = Slider(9, range=0..100)  # disabled
sort_list_3 = SortList(Keys=merge_3, ValuesA=merge_3)  # -> Keys, ValuesA; disabled
number_slider_6 = Slider(3, range=0..10)  # disabled
number_slider_7 = Slider(9, range=0..100)  # disabled
number_slider_8 = Slider(3, range=0..10)  # disabled
number_slider_9 = Slider(9, range=0..100)  # disabled
point_2 = Point(sort_list_2.ValuesValuesA)  # disabled
point_3 = Point(sort_list.ValuesValuesA)  # disabled
point_4 = Point(sort_list_3.ValuesA)  # disabled
unit_z = UnitZ(Factor=number_slider_9)  # disabled
unit_z_2 = UnitZ(Factor=number_slider_5)  # disabled
unit_z_3 = UnitZ(Factor=number_slider_7)  # disabled
nurbs_curve = NurbsCurve(Vertices=point_2, Degree=number_slider_4, Periodic=False)  # -> Curve, Length, Domain; disabled
nurbs_curve_2 = NurbsCurve(Vertices=point_4, Degree=number_slider_6, Periodic=False)  # -> Curve, Length, Domain; disabled
polyline = PolyLine(Vertices=point_3, Closed=False)  # disabled
# 2. TOTAL MATTER
# Up to now we have been looking at matter as such, that is to say
# according to its qualities and in any given volume-as though it
# were permissible for us to break off a fragment and study this
# sample apart from the rest. It is time to point out that this
# procedure is merely an intellectual dodge. Considered in its
# physical, concrete reality, the stuA of the universe cannot divide
# itself but, as a kind of gigantic ' atom ', it forms in its totality
# (apart from thought on which it is centred and concentrated at
# the other end) the only real indivisible. The history of
#  consciousness and its place in the world remain incomprehensible to anyone
# who has not seen first of all that the cosmos in which man finds
# himself caught up constitutes, by reason of the unimpeachable
# wholeness of its whole, a system, a totum and a quantum: a system
# by its plurality, a totum by its unity, a quantum by its energy ;
# all three within a boundless contour.
# Let us try to make this clear.
extrude = Extrude(Base=polyline, Direction=unit_z)  # disabled
extrude_2 = Extrude(Base=nurbs_curve.Curve, Direction=unit_z_2)  # disabled
extrude_3 = Extrude(Base=nurbs_curve_2.Curve, Direction=unit_z_3)  # disabled

# ----
# Degree of Curve
panel_14 = Panel("1")  # disabled
panel_15 = Panel("2")  # disabled
panel_16 = Panel("3")  # disabled
panel_17 = Panel("4")  # disabled
panel_18 = Panel("5")  # disabled

unit_z_4 = UnitZ(Factor=1)

number_slider_10 = Slider(10, range=3.01..10)  # disabled
number_slider_11 = Slider(0.01, range=0.01..10)  # disabled
number_slider_12 = Slider(100, range=0..100)  # disabled
number_slider_13 = Slider(12, range=0..50)  # disabled
panel_19 = Panel("100")  # disabled
panel_20 = Panel("50")  # disabled
construct_domain = ConstructDomain(DomainStart=number_slider_11, DomainEnd=number_slider_10)  # disabled
boolean_toggle_2 = BooleanToggle(True)  # disabled
boolean_toggle_3 = BooleanToggle(False)  # disabled
number_slider_14 = Slider(2.03, range=0..10)  # disabled
number_slider_15 = Slider(1.33, range=0..10)  # disabled
sphere_2 = Sphere(Base=PlaneXY(0, 0, 0), Radius=panel_19)  # disabled
range = Range(Domain=construct_domain, Steps=number_slider_12)  # disabled
populate_geometry = PopulateGeometry(Geometry=sphere_2, Count=number_slider_13, Seed=1)  # disabled
populate_3d = Populate3D(Region=sphere_2, Count=number_slider_13, Seed=boolean_toggle_2)  # disabled
populate_3d_2 = Populate3D(Region=sphere_2, Count=number_slider_13, Seed=boolean_toggle_3)  # disabled
multiplication_3 = Multiplication(A=range, B=number_slider_14)  # disabled
multiplication_4 = Multiplication(A=range, B=number_slider_14)  # disabled
number_slider_16 = Slider(10, range=0..10)  # disabled
plane_3pt = Plane3Pt(PointA=populate_geometry, PointB=populate_3d, PointC=populate_3d_2)  # disabled
cosine = Cosine(Value=multiplication_4)  # disabled
sine_2 = Sine(Value=multiplication_3)  # disabled
negative_2 = Negative(Value=number_slider_16)  # disabled
multiplication_5 = Multiplication(A=range, B=sine_2)  # disabled
multiplication_6 = Multiplication(A=range, B=cosine)  # disabled
construct_domain_2 = ConstructDomain(DomainStart=negative_2, DomainEnd=number_slider_16)  # disabled
construct_point_5 = ConstructPoint(XCoordinate=multiplication_5, YCoordinate=multiplication_6, ZCoordinate=range)  # disabled
rectangle = Rectangle(Plane=plane_3pt, XSize=construct_domain_2, YSize=construct_domain_2, Radius=0)  # -> Rectangle, Length; disabled
interpolate = Interpolate(Vertices=construct_point_5, Degree=3, Periodic=False, KnotStyle=1)  # -> Curve, Length, Domain; disabled
populate_2d = Populate2D(Region=rectangle.Rectangle, Count=number_slider_13, Seed=1)  # disabled
construct_point_6 = ConstructPoint(XCoordinate=0, YCoordinate=0, ZCoordinate=0)  # disabled
construct_plane = ConstructPlane(Origin=populate_2d, XAxis=plane_3pt, YAxis=populate_2d)  # disabled
end_points = EndPoints(Curve=interpolate.Curve)  # -> Start, End; disabled
mesh_sphere = MeshSphere(Base=end_points.End, Radius=number_slider_10, UCount=number_slider_10, VCount=number_slider_10)  # disabled
boolean_toggle_4 = BooleanToggle(True)  # disabled
orient = Orient(Geometry=mesh_sphere, Source=construct_point_6, Target=construct_plane)  # -> Geometry, Transform; disabled
bake_geometry_2 = BakeGeometry(Bake=boolean_toggle_4, Geometry=orient.Geometry, DeleteOldBakes=False, PreserveTrees=False)  # disabled

construct_domain_3 = ConstructDomain(DomainStart=0, DomainEnd=panel)
construct_domain_4 = ConstructDomain(DomainStart=0, DomainEnd=negative)
range_2 = Range(Domain=construct_domain_3, Steps="100")
range_3 = Range(Domain=construct_domain_4, Steps="100")
expression = Expression(x=range_2, Expression="x^2")
expression_2 = Expression(x=range_3, Expression="x^2")
construct_point_7 = ConstructPoint(XCoordinate=range_2, YCoordinate=expression, ZCoordinate=0)
interpolate_2 = Interpolate(Vertices=construct_point_7, Degree=3, Periodic=False, KnotStyle=1)  # -> Curve, Length, Domain

expression_3 = Expression(x=range_3, Expression="x^3")
negative_3 = Negative(Value=expression_3)

construct_point_8 = ConstructPoint(XCoordinate=range_3, YCoordinate=negative_3, ZCoordinate=0)
interpolate_3 = Interpolate(Vertices=construct_point_8, Degree=3, Periodic=False, KnotStyle=1)  # -> Curve, Length, Domain
join_curves = JoinCurves(Curves=[interpolate_2.Curve, interpolate_3.Curve], Preserve=False)  # -> reparameterize(Curves)

construct_domain_5 = ConstructDomain(DomainStart=negative, DomainEnd=panel)
rectangle_2 = Rectangle(Plane=PlaneXY(0, 0, 0), XSize=construct_domain_5, YSize=construct_domain_5, Radius=0)  # -> Rectangle, Length
trim_with_region = TrimWithRegion(Curve=join_curves, Region=rectangle_2.Rectangle)  # -> Inside, Outside
curve = Curve(reparameterize(trim_with_region.Inside))

curvature_graph = CurvatureGraph(Curve=curve, Density=Slider(4.09, range=0..10), Scale=Slider(100, range=0..100))
curvature = Curvature(Curve=curve, Parameter=Slider(0.509, range=0..1))  # -> Point, Curvature, Curvature_2

# ----
# Show continuity with a curvature circle
point_5 = Point(curvature.Point)
vector = Vector(curvature.Curvature)
curve_2 = Curve(curvature.Curvature_2)
extrude_4 = Extrude(Base=curve, Direction=unit_z_4)
vector_display_5 = VectorDisplay(Anchor=curvature.Point, Vector=vector)

# ----
# BOOK ONE
# BEFORE LIFE CAME
# Curve creation and continuilty
# concepts and techniques related to NURBS curves
# 
# Curve building techniques have a significant
#  effect on the surfaces that you build from them
# 
# Curve degree
# The degree of a curve refers to the highest
#  degree polynomial in the equation for the curve,
# it relates to the extent of the influence a single
# control point has ove the length of the curve
# Create random pts in the x-direction
# Indicates the curvature on the curve
# This is the inverse of the radius curvature
# Smaller radius of curvature at t,
# the larger the amount of curvature
# Create Geometry
number_slider_17 = Slider(1.91, range=0.1..4)  # disabled
number_slider_18 = Slider(93, range=0..100)  # disabled
# https://www.holybooks.com/wp-content/uploads/Phenomenon-of-Man-by-Pierre-Teilhard-de-Chardin.pdf
# From the dawn of his existence, man has been held up as a
# spectacle to himself. Indeed for tens of centuries he has looked at
# nothing but himself. Yet he has onlyjust begun to take a scientific
# view of his own significance in the physical world. There is no
# need to be surprised at this slow awakening. It often happens
# that what stares us in the face is the most difficult to perceive.
# The child has to learn to separate out the images which assail
# the newly-opened retina. For man to discover man and take his
# measure, a whole series of ' senses ' have been necessary, whose
# gradual acquisition, as we shall show, covers and punctuates the
# whole history of the snuggles of the mind :
# A sense of spatial immensity, in greatness and smallness, dis
# articulating and spacing out, withln a sphere of indefinite radius,
# the orbits of the objects which press round us ;
# A sense of depth, pushing back laboriously through endless
# series and measureless distances of time, which a sort of sluggish
# ness of mind tends continually to condense for us in a thin layer
# of he past ;
# A sense of number, discovering and grasping unflinchingly
# the bewildering multitude of material or living elements involved
# in the slightest change in the universe ;
# A sense of proportion, realising as best we can the di&rence
# of physical scale which separates, both in rhythm and dimension,
# the atom from the nebula, the infmitesimal from the immense ;
# A sense of quality, or of novelty, enabling us to distinguish in
# nature certain absolute stages of perfection and growth, without
# upsetting the physical unity of the world ;
# A sense of movement, capable of perceiving the irresistible
# development. hidden in extreme slowness-extreme agitation
# concealed beneath a veil of immobility-the entirely new insinuating
# itself into the heart of the monotonous repetition of the
# same things ;
# A sense, lastly, of the organic, discovering physical links and
# structural unity under the superficial juxtaposition of successions
# and collectivities.
# Without these qualities to illuminate our vision, man will
# remain indefinitely for us-whatever is done to make us seewhat he
# still reprcsents to so many minds : an erratic object in a
# disjointed world. Conversely, we have only to rid our vision of
# the threefold illusion of smallness, plurality and immobility, for
# man effortlessly to take the central position we prophesied-the
# momentary summit of an anthropogenesis which is itself the
# crown of a cosmogenesis.
number_slider_19 = Slider(6, range=3..10)  # disabled
negative_4 = Negative(Value=number_slider_17)  # disabled
construct_domain_6 = ConstructDomain(DomainStart=negative_4, DomainEnd=number_slider_17)  # disabled
series = Series(Start=0, Step=1, Count=number_slider_19)  # disabled
number_slider_20 = Slider(0, range=0..4)  # disabled
number_slider_21 = Slider(4, range=1..4)  # disabled
random = Random(Range=construct_domain_6, Number=number_slider_19, Seed=number_slider_18)  # disabled
addition = Addition(A=random, B=panel_16)  # disabled
construct_point_9 = ConstructPoint(XCoordinate=0, YCoordinate=addition, ZCoordinate=series)  # disabled
stream_filter = StreamFilter(Gate=number_slider_21, Stream0=panel_14, Stream1=panel_15, Stream2=panel_16, Stream3=panel_17, Stream4=panel_18)  # disabled
nurbs_curve_3 = NurbsCurve(Vertices=construct_point_9, Degree=stream_filter, Periodic=False)  # -> Curve, Length, Domain; disabled
construct_point_10 = ConstructPoint(XCoordinate=0, YCoordinate=0, ZCoordinate=0)  # disabled
number_slider_22 = Slider(12, range=0..100)  # disabled
line_sdl = LineSDL(Start=construct_point_10, Direction=Vector(0, 0, 1), Length=1)  # disabled
unit_x = UnitX(Factor=number_slider_22)  # disabled
number_slider_23 = Slider(2, range=0..10)  # disabled
number_slider_24 = Slider(0.04, range=0..1)  # disabled
linear_array = LinearArray(Geometry=construct_point_10, Direction=unit_x, Count=stream_filter)  # -> Geometry, Transform; disabled
list_item_2 = ListItem(List=linear_array.Geometry, Index=expr("x-1", stream_filter), Wrap=True)  # disabled
boolean_toggle_5 = BooleanToggle(False)  # disabled

# ----
# Turn On Control Points of Curve
number_slider_25 = Slider(5, range=0..10)  # disabled
control_points = ControlPoints(Curve=nurbs_curve_3.Curve)  # -> Points, Weights, Knots; disabled
point_6 = Point(control_points.Points)  # disabled
list_item_3 = ListItem(List=point_6, Index=number_slider_25, Wrap=True)  # disabled
number_slider_26 = Slider(-1, range=-3..3)  # disabled
deconstruct_vector = DeconstructVector(Vector=list_item_3)  # -> XComponent, YComponent, ZComponent; disabled
addition_2 = Addition(A=deconstruct_vector.YComponent, B=number_slider_26)  # disabled
construct_point_11 = ConstructPoint(XCoordinate=deconstruct_vector.XComponent, YCoordinate=addition_2, ZCoordinate=deconstruct_vector.ZComponent)  # disabled
replace_items = ReplaceItems(List=control_points.Points, Item=construct_point_11, Indices=number_slider_25, Wrap=False)  # disabled
nurbs_curve_4 = NurbsCurve(Vertices=replace_items, Degree=stream_filter, Periodic=False)  # -> Curve, Length, Domain; disabled

# ----
# Rebuilding Curve
number_slider_27 = Slider(6, range=0..10)  # disabled
rebuild_curve = RebuildCurve(Curve=nurbs_curve_4.Curve, Count=number_slider_27, Degree=stream_filter, EndTangents=False)  # disabled

# ----
# Curvature Graph: Circle and Vector
t = Slider(0.32, range=0..1)  # disabled
curvature_2 = Curvature(Curve=reparameterize(rebuild_curve), Parameter=t)  # -> Point, Curvature, Curvature_2; disabled
circle_2 = Circle(curvature_2.Curvature_2)  # disabled
vector_2 = Vector(curvature_2.Curvature)  # disabled
vector_display_6 = VectorDisplay(Anchor=curvature_2.Point, Vector=vector_2)  # disabled

panel_21 = Panel("50")  # disabled
# Thus the unity of homogeneity.
# 
# To the cosmic corpuscles we
# should find it natural to attribute an individual radius of action
# as limited as their dimensions. We find, on the contrary, that
# each of them can only be defined by virtue of in influence on all
# around it. Whatever space we suppose it to be in, each cosmic
# element radiates in it and entirely fills it. However narrowly the
# ' heart ' ofan atom may becircurnscribed, in realm is co-extensive,
# at least potentially, with that of every other atom. This strange
# property we will come across again, even in the human molecule.
# 
# We add : collective unity.
# 
# The innumerable foci which share
# a given volume of matter are not therefore independent of each
# other. Something holds them together. Far from behaving as a
# mere inert receptacle, the space filled by their multitude operates
# upon it like an active centre of direction and transmission in which
# their plurality is organiscd. We do not get what we call matter
# as a result of the simple aggregation and juxtaposition of atoms.
# For that, a mysterious identity must absorb and cement them, an
# influence at which our mind rebels in bewilderment at first but
# which in the end it must perforce accept.
# 
# We mean the sphere above the centres and enveloping them.
# Throughout these pages, in each new phase of anthrop*
# genesis, we shall find ourselves faced by the unimaginable reality
# of collective bonds, and we shall have to struggle with them
# without ceasing until we succeed in recognising and defining their
# true nature.
# 
# Here in the beginning it is sufficient to include them
# all under the empirical name given by science to their common
# initial principle, namely enwgy.
panel_22 = Panel("10")  # disabled
multiplication_7 = Multiplication(A=panel_21, B=panel_22)  # disabled
mesh_sphere_2 = MeshSphere(Base=PlaneXY(0, 0, 0), Radius=panel_21, UCount=10, VCount=20)  # disabled
populate_3d_3 = Populate3D(Region=mesh_sphere_2, Count=multiplication_7, Seed=1)  # disabled
panel_23 = Panel("3")  # disabled
number_slider_28 = Slider(1, range=0..1)  # disabled
number_slider_29 = Slider(3.1572, range=3..5)  # disabled
number_slider_30 = Slider(4.19, range=3..5)  # disabled

# ----
# IsInside = mesh.IsPointInside(pt, tol, true);
testpointinsidemesh = TestPointInsideMesh(mesh=mesh_sphere_2, pt=populate_3d_3)  # -> out, IsInside; inputs mesh: Mesh, pt: Point3d, tol: Double; disabled
# ---------- testpointinsidemesh: C# usings ----------
using System.IO;
using System.Linq;
using System.Data;
using System.Drawing;
using System.Reflection;
using System.Windows.Forms;
using System.Xml;
using System.Xml.Linq;
using System.Runtime.InteropServices;

using Rhino.DocObjects;
using Rhino.Collections;
using GH_IO;
using GH_IO.Serialization;
# ---------- testpointinsidemesh: C# ----------
    //Test if a given point is inside a mesh
    IsInside = mesh.IsPointInside(pt, tol, true);
# ---------- end testpointinsidemesh ----------

cull_pattern = CullPattern(List=populate_3d_3, CullPattern=testpointinsidemesh.IsInside)  # disabled
list_length_2 = ListLength(List=flatten(cull_pattern))  # disabled
construct_domain_7 = ConstructDomain(DomainStart=panel_23, DomainEnd=list_length_2)  # disabled
range_4 = Range(Domain=construct_domain_7, Steps=expr("x-1", list_length_2))  # disabled
integer = Integer(range_4)  # disabled
mesh_sphere_3 = MeshSphere(Base=flatten(cull_pattern), Radius=number_slider_28, UCount=integer, VCount=integer)  # disabled
mesh_volume = MeshVolume(Mesh=mesh_sphere_3)  # -> Volume, Centroid; disabled
panel_24 = Panel(mesh_volume.Volume)  # disabled
larger_than = LargerThan(FirstNumber=mesh_volume.Volume, SecondNumber=number_slider_29)  # -> LargerThan, OrEqualTo; disabled
smaller_than = SmallerThan(FirstNumber=mesh_volume.Volume, SecondNumber=number_slider_30)  # -> SmallerThan, OrEqualTo; disabled
cull_pattern_2 = CullPattern(List=mesh_sphere_3, CullPattern=larger_than.OrEqualTo)  # disabled
# C. Energy
# Under this name, which conveys the experience of effort with
# which we are familiar in ounelves, physics has introduced the
# precise formulation of a capacity for action or, more exactly, for
# interaction. Energy is the measure of that which passes from one
# atom to another in the course of their transformations. A unifying
# power, then, but also, because the atom appears to become
# enriched or exhausted in the course of the exchange, the expression
# of structure
# 
# From the aspect of energy, renewed by radio-active phen*
# mena, material corpuscles may now be treated as transient
# reservoirs of concentrated power. Though never found in a state
# of purity, but always more or less granulated (even in light)
# energy nowadays represents for science the most primitive form
# of universal stuff. Hence we find our minds instinctively tending
# to represent energy as a kind of homogeneous, primordial flux
# in which all that has shape in the world is but a series of fleeting
# ' vortices '. From this point of view, the universe would find its *
# stability and final unity at the end of its decomposition. It would be
# held together from below.
# 
# Let us keep the discoveries and indisputable measurements of
# physics. But let us not become bound and fettered to the
# perspective of final equilibrium that they seem to suggest. A more
# complete study of the movements of the world will oblige us,
# little by little, to turn it upside down ; in other words, to discover
# that if things hold and hold together, it is only by reason of
# complexity, -from above.
cull_pattern_3 = CullPattern(List=cull_pattern_2, CullPattern=smaller_than.SmallerThan)  # disabled

# ----
# Check if Polyline End Script Here
panel_25 = Panel("Contains(x,\"line\")")  # disabled
panel_26 = Panel(nurbs_curve_3.Curve)  # disabled
eval = Evaluate(F=panel_25, x=panel_26)  # disabled
panel_27 = Panel(eval)  # disabled

stream_gate = StreamGate(Stream=nurbs_curve_3.Curve, Gate=eval)  # -> Target0, Target1; disabled

curve_3 = Curve(stream_gate.Target1)  # disabled

stream_filter_2 = StreamFilter(Gate=eval, Stream0=rebuild_curve, Stream1=curve_3)  # disabled
revolution = Revolution(Curve=stream_filter_2, Axis=line_sdl, Domain=Domain(0, 6.283185307))  # disabled
cap_holes = CapHoles(Brep=revolution)  # disabled
shell_polysurface = ShellPolysurface(Polysurface=cap_holes, Removal=number_slider_23, Thickness=number_slider_24, FaceMerge=False)  # disabled
orient_2 = Orient(Geometry=shell_polysurface, Source=construct_point_10, Target=list_item_2)  # -> Geometry, Transform; disabled
object_bake = ObjectBake(
    BakeToggle=boolean_toggle_5,
    GeometryObjects=orient_2.Geometry,
    Layer="GH_Bake",
    ObjectName="GH_Obj",
    ObjectColor=RGB(255, 255, 255),
    LayerColor=RGB(255, 255, 255))  # disabled
